# Grasshopper definition GH tower srial connection.ghx (Grasshopper 0.8.10)

ports_available = COMPortsAvailable()
open_port = OpenClosePort(OpenClosePort=Toggle(True), PortNumber=4, BaudRate=9600)
timer = Timer(TimerInterval=20, Target=toggle)
toggle = BooleanToggle(True)
read = SerialReadGeneric(StartReadingValues=toggle, PortNumber=Slider(4, range=0..4))  # -> SerialOutput, StatusMessage
panel = Panel(read.SerialOutput)
panel_2 = Panel(read.StatusMessage)
division = Division(A=read.SerialOutput, B=Slider(24, range=0..100))
pi = Pi(Factor=Slider(2.538, range=0..4))
slider = Slider(33, range=0..50)
dom = Domain(DomainStart=Slider(0.25, range=0..1), DomainEnd=division)
range = Range(Domain=Domain(0, 1), Steps=expr("n-1", slider))
range_2 = Range(Domain=dom, Steps=expr("n-1", slider))
series = Series(Start=0, Step=Slider(2.27, range=0..7), Count=slider)
ellipse = Ellipse(Base=PlaneXY(0, 0, 0), Radius1=Slider(7, range=0..50), Radius2=Slider(13, range=0..50))  # -> Ellipse, Focus1, Focus2
graph = GraphMapper(
    range,
    x0=0,
    x1=1,
    y0=0,
    y1=1,
    container_name="Bezier",
    cpx=[0, 0.2934778333, 0.2481884062, 1],
    cpy=[0, 0.9836961031, 0.2318840623, 0.1594202965])
graph_2 = GraphMapper(
    range,
    x0=0,
    x1=1,
    y0=0,
    y1=1,
    container_name="Bezier",
    cpx=[0, 0.297101438, 0.6594203115, 1],
    cpy=[0, 0.9275362492, 0.8550724387, 0.03623188287])
slider_2 = Slider(0.538, range=0..1)
Z = UnitZ(Factor=series)
move = Move(Geometry=ellipse.Ellipse, Translation=Z)  # -> Geometry, Transform
multiplication = Multiplication(A=Slider(3.359, range=0..75), B=graph)
rotate = Rotate(Geometry=move.Geometry, Angle=range_2, Plane=PlaneXY(0, 0, 0))  # -> Geometry, Transform
multiplication_2 = Multiplication(A=Slider(2.5, range=0..20), B=graph_2)
X = UnitX(Factor=multiplication)
move_2 = Move(Geometry=rotate.Geometry, Translation=X)  # -> Geometry, Transform
Y = UnitY(Factor=multiplication_2)
f_x_y = F2(Function="(x+y)/2", X=graph, Y=graph_2)
move_3 = Move(Geometry=move_2.Geometry, Translation=Y)  # -> Geometry, Transform
planar = PlanarSrf(Edges=move_3.Geometry)
multiplication_3 = Multiplication(A=Slider(1.016, range=0..4), B=f_x_y)
area = BrepArea(Brep=planar)  # -> Area, Centroid
subtraction = Subtraction(A=1, B=multiplication_3)
scale = Scale(Geometry=move_3.Geometry, Center=area.Centroid, Factor=subtraction)  # -> Geometry, Transform
planar_2 = PlanarSrf(Edges=scale.Geometry)
Z_2 = UnitZ(Factor=Slider(2.125, range=0..3))
loft = Loft(Section=scale.Geometry, Options={Adjust=False, Closed=False, Rebuild=10, Refit=0.01, LoftType=0, LoftEnds=0, LoftSimp=0})
extr = Extrude(Base=planar_2, Direction=Z_2)
